# Grasshopper definition CutFloorplates.gh (Grasshopper 1.0.8)

geomin = Geometry()

# ---- group: Inputs
floor_thickness = Slider(0.2, range=0..1)
initial_floor_height = Slider(0, range=0..10)
floor_height = Slider(3.5, range=2..6)

# ----
bbox = BoundingBox(Content=geomin, Plane=PlaneXY(0, 0, 0))  # -> Box, Box_2
negative = Negative(Value=floor_thickness)
Z = UnitZ(Factor=negative)
debox = DeconstructBox(Box=bbox.Box)  # -> Plane, X, Y, Z
dedomain = DeconstructDomain(Domain=debox.Z)  # -> Start, End
subtraction = Subtraction(A=dedomain.End, B=initial_floor_height)
division = Division(A=subtraction, B=floor_height)
round = Round(Number=division)  # -> Nearest, Floor, Ceiling
addition = Addition(A=round.Floor, B=1)
series = Series(Start=initial_floor_height, Step=floor_height, Count=addition)
pt = ConstructPoint(XCoordinate=0, YCoordinate=0, ZCoordinate=series)
xy = XYPlane(Origin=pt)
sec = BrepPlane(Brep=geomin, Plane=xy)  # -> Curves, Points
boundary = BoundarySurfaces(Edges=sec.Curves)
last_item = ListItem(List=boundary, Index=-1, Wrap=True)
extrude = Extrude(Base=boundary, Direction=Z)

# ---- group: Outputs
facade = Geometry(geomin)
geomout = Geometry(extrude)
roof = Geometry(last_item)
