# Grasshopper definition SubDivide.ghx (Grasshopper 1.0.8)
# plug-ins: LunchBox

geomin = Geometry(<brep referenced from the Rhino model>)
explode = ExplodeObject(Object=geomin, Recursive=False)
diamond = DiamondPanels(Surface=explode, UDivisions=10, VDivisions=10)  # -> DiamondPanels, TriPanels
geomout = Geometry(flatten([diamond.DiamondPanels, diamond.TriPanels]))
