# Grasshopper definition move.ghx (Grasshopper 1.0.8)

# ---- group: Inputs
number_slider = Slider(0, range=0..10)

# ----
geomin = Geometry()
Z = UnitZ(Factor=number_slider)
move = Move(Geometry=geomin, Motion=Z)  # -> Geometry, Transform
geomout = Geometry(move.Geometry)
